# Grasshopper definition theater_sightlines.gh (Grasshopper 1.0.7)

# ---- group: Calculate C-Value
# scale => 1:100
# standard of measurement : floor to head
# - sitting_height : 12.6
# - sitting_sight_level : 11.5
# - seat_depth : 5
number_slider = Slider(8.5, range=7..10)
number_slider_2 = Slider(4.2, range=3..5)
point = Point([Point(0, -2.5, 7.943933452), Point(-0.5003125752, -2.5, 7.943933452), Point(-0.5003125752, -2.5, 4.999638125), Point(-5, -2.5, 4.999638125), Point(-5, -2.5, 4.499638125), Point(-4.5, -2.5, 4.499638125), Point(-4.5, -2.5, -0.0003618753641), Point(-4, -2.5, -0.0003618753641), Point(-4, -2.5, 4.499638125), Point(-0.5, -2.5, 4.499638125), Point(-0.5, -2.5, -0.0003618753641), Point(0, -2.5, -0.0003618753641), Point(0, -2.5, 7.943933452)])
point_2 = Point([Point(307.3443937, 30.81644905, 119.1163868), Point(69.05908887, 30.81644905, 119.1163868), Point(69.05908887, 30.81644905, -50.15866179), Point(307.3443937, 30.81644905, -50.15866179), Point(307.3443937, 30.81644905, 119.1163868)])
# constFind the optimal C-value within
# the below constraints.
# 
# ceil height >= 23
# step margin >= 3.5
ghpython_script = GhPythonScript(step_width=number_slider, step_height=number_slider_2, chair_pts=point, cutter_pts=point_2)  # -> out, auditorium_brep, auditorium_chairs, auditorium_height, auditorium_section, auditorium_focus, auditorium_cvalue, ceil_height, step_margin; inputs chair_pts: list of Point3d, cutter_pts: list of Point3d
# ---------- ghpython_script: Python ----------
import math
import random
import Rhino.Geometry as rg
import Rhino.RhinoDoc as rc
import rhinoscriptsyntax as rs
import ghpythonlib.components as gh


class Point:
    def __init__(self, x, y, z):
        self.x = x
        self.y = y
        self.z = z
        self.coordinate = self.get_coordinate()
        
    def get_coordinate(self):
        return [self.x, self.y, self.z]
        
    def generate_point(self):
        x, y, z = self.coordinate
        point = rs.AddPoint(x,y,z)
        return rs.PointCoordinates(point)
        
        
class Curve:
    def __init__(self, points):
        self.DEGREE = 1
        self.DISTANCE = 5
        self.DIRECTION = [0, 0, 0]
        self.points = points
        self.curve = self.generate_curve()
        
    def generate_curve(self):
        return rs.AddCurve(self.points, self.DEGREE)
        
    def offset_curve(self):
        return rs.OffsetCurve(self.curve, self.DIRECTION, self.DISTANCE)[0]
        
        
class Surface:
    def __init__(self, crvs):
        self.crvs = crvs
        self.srf = self.generate_surface()
        
    def generate_surface(self):
        return rs.AddPlanarSrf(self.crvs)
        
    def extrude_surface(self, direction):
        return rs.ExtrudeSurface(self.srf, direction)
        
        
class Auditorium:
    def __init__(self, step_height, step_width, cutter_pts):
        self.SCALE = 100
        self.START_X = 110
        self.END_X = 270
        self.STEP_COUNT = 10
        self.STEP_X = 160
        self.STEP_Y = 0
        self.CHAIR_Y = 5
        self.CEIL_Z = 65
        self.CHAIRS = 11
        self.SIGHT_LEVEL = 11.5
        self.SECTION_M = [230, 0, 0]
        self.DIRECTION_A = self.auditorium_direction()
        self.DIRECTION_C = self.chair_direction()
        
        self.step_width = step_width
        self.step_height = step_height
        self.cutter_pts = cutter_pts
        self.base_pts = self.base_points()
        self.base_crvs = self.base_curves()
        self.auditorium = self.generate_auditorium()
        self.chairs = []
        
    def base_points(self):
        base_pts = [Point(self.START_X,0,0).generate_point()]
        mul_list = []
        for i in range(self.STEP_COUNT+1):
            mul_list.extend([i, i])
            
        for i in zip(mul_list[:-1], mul_list[1:]):
            point = Point(self.STEP_X + self.step_width * i[0],
                          self.STEP_Y,
                          self.step_height * i[1])
            base_pts.append(point.generate_point())
        base_pts[-1][0] = self.END_X
        
        ceil_pt_1 = Point(self.END_X, self.STEP_Y, self.CEIL_Z)
        ceil_pt_2 = Point(self.START_X, self.STEP_Y, self.CEIL_Z)
        base_pts.extend([ceil_pt_1.generate_point(),
                         ceil_pt_2.generate_point(),
                         base_pts[0]])
        return base_pts
        
    def base_curves(self):
        crv_1 = Curve(self.base_pts).generate_curve()
        crv_2 = Curve(self.base_pts).offset_curve()
        return crv_1, crv_2
        
    def base_surface(self):
        return Surface(self.base_crvs).generate_surface()
        
    def auditorium_direction(self):
        pt1 = Point(self.STEP_Y, self.STEP_Y, self.STEP_Y).generate_point()
        pt2 = Point(self.STEP_Y ,self.CEIL_Z ,self.STEP_Y).generate_point()
        return Curve([pt1, pt2]).generate_curve()
        
    def chair_direction(self):
        pt1 = Point(self.STEP_Y, self.STEP_Y, self.STEP_Y).generate_point()
        pt2 = Point(self.STEP_Y, self.CHAIR_Y, self.STEP_Y).generate_point()
        return Curve([pt1, pt2]).generate_curve()
        
    def generate_auditorium(self):
        return Surface(self.base_crvs).extrude_surface(self.DIRECTION_A)
        
    def elements_auditorium(self, brep):
        try:
            faces, edges, vertices = gh.DeconstructBrep(rs.coercebrep(brep))
        except:
            faces, edges, vertices = gh.DeconstructBrep(brep)
        return faces, edges, vertices
        
    def generate_chairs(self, chair_pts):
        chair_crv = Curve(chair_pts).generate_curve()
        chair_ori = Surface(chair_crv).extrude_surface(self.DIRECTION_C)
        auditorium_lines = self.elements_auditorium(self.auditorium)[1]
        lines_index = [i for i in range(106, 142, 4)]
        for i in lines_index:
            base_curve = auditorium_lines[i]
            base_points = gh.DivideCurve(base_curve, self.CHAIRS, False)[0]
            base_points.pop(0); base_points.pop(-1)
            for bp in base_points:
                chair = rs.CopyObject(chair_ori, bp)
                self.chairs.append(chair)
        return self.chairs
        
    def generate_section(self):
        cutter_crv = Curve(self.cutter_pts).generate_curve()
        cutter = Surface(cutter_crv).generate_surface()
        cutting_idx = [i for i in range(5, 95, 10)]
        section_lines = []
        for i in cutting_idx:
            split_chair = rs.SplitBrep(self.chairs[i], cutter)[1];\
                          rs.CapPlanarHoles(split_chair)
            section_chair = self.elements_auditorium(split_chair)[0][0]
            section_lines.append(section_chair)
        
        split_auditorium = rs.SplitBrep(self.auditorium, cutter)[1];\
                           rs.CapPlanarHoles(split_auditorium);
        section_auditorium = self.elements_auditorium(split_auditorium)[0][0]
        section_lines.append(section_auditorium)
        rs.MoveObjects(section_lines, self.SECTION_M)
        return section_lines
        
    def generate_sight(self):
        section_lines = self.generate_section()[-1]
        sitting_lines = self.elements_auditorium(section_lines)[1]
        base_line = self.elements_auditorium(section_lines)[1][24]
        sight_points = gh.CurveMiddle([sitting_lines[37], sitting_lines[39]]);\
                       rs.MoveObjects(sight_points, [0,0,self.SIGHT_LEVEL])
        focus_point = rs.CurvePoints(base_line)[0]
        
        sight_curve = Curve([sight_points[0], focus_point, sight_points[1]]).generate_curve()
        return [sight_curve, sight_points[0], sight_points[1]]
        
    def calculate_ceil_height(self):
        ceil_height = rs.Distance(self.base_pts[-3], self.base_pts[-4]) * self.SCALE
        limit_height = 2300
        
        if ceil_height < limit_height:
            return 0
        else:
            return ceil_height
        
    def calculate_step_margin(self):
        margin_space = (self.step_width - self.CHAIR_Y) * self.SCALE
        limit_margin = 350
        
        if margin_space < limit_margin:
            return 0
        else:
            return margin_space
        
    def calculate_cvalue(self):
        curr_ceil_height = self.calculate_ceil_height()
        curr_step_width = self.calculate_step_margin()
        
        sight_elements = self.generate_sight()
        cal_crv = sight_elements[0]
        cal_pt_1 = sight_elements[1]
        cal_vect = Point(0,0,1).generate_point()
        cal_line = gh.LineSDL(cal_pt_1, cal_vect, 30)
        cal_pt_2 = gh.CurveXLine(rs.coercecurve(cal_crv), cal_line)[0][1]
        
        if curr_ceil_height == 0 or curr_step_width == 0:
            cvalue = 0
        else:
            cvalue = rs.Distance(cal_pt_1, cal_pt_2) * self.SCALE
        return round(cvalue, 2)
        
    def visualization_text(self):
        pass


if __name__ == "__main__":
    auditorium = Auditorium(step_height, step_width, cutter_pts)
    auditorium_brep = auditorium.generate_auditorium()
    auditorium_chairs = auditorium.generate_chairs(chair_pts)
    auditorium_section = auditorium.generate_section()
    
    auditorium_focus = auditorium.generate_sight()
    auditorium_cvalue = auditorium.calculate_cvalue()
# ---------- end ghpython_script ----------
geometry = Geometry(ghpython_script.auditorium_chairs)
geometry_2 = Geometry(ghpython_script.auditorium_focus)
number = Number(ghpython_script.auditorium_cvalue)
# 60 : Need to look between heads in front
# 90 : Can see well with head tilted backwards
# 120 : Optimal viewing standard
# 150 : Can see well even if over spectators with hats
custom_preview = CustomPreview(
    Geometry=[ghpython_script.auditorium_brep, geometry, ghpython_script.auditorium_section],
    Material=ColourSwatch(SwatchColor=RGB(194, 0, 0)))
c_value = Panel(number)
# step width
# step margin
# ceil height
# c-value
galapagos = Galapagos(fitness=number, gene=[number_slider, number_slider_2])

# ---- group: Text Visualization
deconstruct_brep = DeconstructBrep(Brep=ghpython_script.auditorium_section)  # -> Faces, Edges, Vertices
list_item = ListItem(List=flatten(deconstruct_brep.Vertices), Index=286, Wrap=True)
unit_x = UnitX(Factor=29)
list_item_2 = ListItem(List=flatten(deconstruct_brep.Edges), Index=154, Wrap=True)
move = Move(Geometry=list_item, Motion=unit_x)  # -> Geometry, Transform
xz_plane = XZPlane(Origin=move.Geometry)
text_tag_3d = TextTag3D(Location=xz_plane, Text="Calculate C-Value", Size=5, Justification=1)

# ----
line_dimension = LineDimension(Line=list_item_2, Text="{0:0.0}", Size=5)
